vi "index.gviweb"   [G Web Development Software 22.3.0]
panel controls:
  "Exit (development only)": bool
  "Test Start": bool
  "Test Sequence": T3[]
  "Cancel": bool
panel indicators:
  "Test Duration (s)": f64
  "Step Status": T1[]
  "Program Log": string
  "Program Status": string
  "Initialized": bool
  "Finalized": bool
  "Graph": f64[][]
  "Result": bool
types:
  "Color.gtype" = u32
  T1 = cluster{"Progress": f64, "Result": "Color.gtype"}
  T2 = cluster{"Waveform": enum{"Constant", "Sawtooth", "Sinusoid"}, "Amplitude": f64, "Frequency": f64}
  T3 = cluster{"Duration (s)": f64, "Waveform Data": T2, "Fault Probability": f64}
  "Step Result.gtype" = enum{"Pass", "Fail", "Canceled"}
  "Step Status.gtype" = cluster{"Progress": f64, "Result": "Step Result.gtype", "Complete": bool}
  "Waveforms.gtype" = enum{"Constant", "Sawtooth", "Sinusoid"}
  "Waveform Data.gtype" = cluster{"Waveform": "Waveforms.gtype", "Amplitude": f64, "Frequency": f64}
  "Test Step Data.gtype" = cluster{"Duration (s)": f64, "Waveform Data": "Waveform Data.gtype", "Fault Probability": f64}
  "IO Data.gtype" = cluster{"Waveform": "Waveforms.gtype", "Duration (s)": f64, "Start Time": timestamp, "Time Factor": f64, "Adjusted Amplitude": f64, "New Wave": bool, "Wave Active": bool, "Fault start time": f64}
  "Manager State.gtype" = enum{"Idle", "Initialize", "Execute", "Finalize", "Cancel", "Error"}
  "Message Queue Names.gtype" = enum{"Manager", "UI", "IO"}
  "Step Data.gtype" = cluster{"Message Queue": "Message Queue Names.gtype", "Action": string}
  "Sequence.gtype" = cluster{"Manager State": "Manager State.gtype", "Steps": "Step Data.gtype"[]}
  "Manager Data.gtype" = cluster{"Current State": "Manager State.gtype", "Current Step": "Step Data.gtype", "Remaining Steps": "Step Data.gtype"[], "Remaining Sequences": "Sequence.gtype"[], "Current Instruction": string}
  "Error Data.gtype" = cluster{"Error Origin": "Message Queue Names.gtype", "Error In": error}
uses:
  WebApp::support::Message Queue::Create All Message Queues.gvi
  WebApp::support::Message Queue::Dequeue Message.gvi
  WebApp::UI::Define Preset Test Sequence.gviweb
  WebApp::UI::Prep Step Staus for Display.gviweb
  WebApp::UI::Calculate Test Duration.gviweb
  WebApp::UI::Validate Test Sequence.gviweb
  WebApp::program instructions::Report Step Complete.gviweb
  WebApp::UI::IO Data::Handle Data Remaining in Queue.gviweb
  WebApp::UI::Get Result Color.gviweb
  WebApp::UI::IO Data::Receive IO Data.gviweb
  WebApp::support::Generate Undefined Message Error.gviweb
  WebApp::support::Handle Error.gviweb
  WebApp::support::globals.gviweb
  WebApp::IO::Handle Next Waveform.gviweb
  WebApp::IO::Generate Waveform.gviweb
  WebApp::IO::Handle Hardware IO.gviweb
  WebApp::development::Check Test Sequence Complete.gviweb
  WebApp::program instructions::Define Program Instructions.gviweb
  WebApp::support::Message Queue::Enqueue Message (Single).gvi
  WebApp::UI::Messages::Append Log Text.gviweb
  WebApp::program instructions::Handle Next Sequence.gviweb
  WebApp::program instructions::Handle Next Step.gviweb
  NI::G Core::Error::Build Error Cluster.gvi
  WebApp::UI::Messages::Send Sequence Complete UI Updates.gviweb
  WebApp::UI::Messages::Update Program Status.gviweb
  WebApp::support::Error Handler - Event Handling Loop.gvi
diagram:
  w1 = bool FALSE  # Stop Event
  Create User Event[EventName="Stop Event"](user event data type=w1) -> (error out=w2, user event out=w3)
  Obtain Queue(element data type=f64[] [], name="IO data") -> (error out=w4, queue out=w5)
  w6 = ["Manager", "UI", "IO"]  # Queue List
  # #feature_queue
  # Hardware fault
  # 	be able to clear error with corresponding case in IO
  # 	handle during initialize or execute
  # Abort
  # Pause
  # Pass initial instruction data to individual steps
  # Display test history/ data
  # Select between historical test data for display
  # 	Historical analysis/ comparison
  # Splining/ smooth transitions between waveforms
  # 	Force sawtooth to return to 0 before waveform transition?
  # Unit tests
  # Check for empty test sequence
  Array Size(array=w6) -> (size(s)=w7)
  call "Create All Message Queues.gvi"(Loop Count=w7, error in=w2) -> (Message Queues=w8, error out=w9)
  Array Index(array=w8) -> (out0["Manager"]=w10, out1["UI"]=w11)
  Merge Errors(w9, w4) -> (error out=w12)
  s1 = uninitialised  # shift register
  s2 = uninitialised  # shift register
  s3 = uninitialised  # shift register
  s4 = uninitialised  # shift register
  s5 = uninitialised  # shift register
  s6 = uninitialised  # shift register
  while {
    call "Dequeue Message.gvi"(message queue in=w11, timeout in milliseconds=s2, error in=w12) -> (timed out?=w13, message queue out=w14, message=w15, message data=w16, error out=w17)
    # UI Update Loop
    # s6: Step Index
    # s5: Test Steps
    # s2: Dequeue Timeout
    case (w15) ignore case {  # Message Cases
      frame "SW Init" {
        Property Node(instance in=reference to "Result", "Value"=FALSE, "Text"=[" ", " "])
        Property Node(instance in=reference to "Initialized", "Value"=FALSE)
        Property Node(instance in=reference to "Finalized", "Value"=FALSE)
        Property Node(instance in=reference to "Finalized", "Value"=FALSE)
        Property Node(instance in=reference to "Test Sequence", "Disabled"=FALSE)
        Property Node(instance in=reference to "Initialized", "Value"=FALSE, error in=w17) -> (error out=w26, instance out=w27)
        Property Node(instance in=reference to "Program Status", "Value"="Idle", error in=w17) -> (error out=w28, instance out=w29)
        Property Node(instance in=reference to "Program Log", "Value"="", error in=w17) -> (error out=w30, instance out=w31)
        Build Array(w27, w29, w31) -> w32
        Merge Errors(w26, w28, w30) -> (error out=w33)
        s7 = w33  # shift register
        for {
          w34 = each element of w32
          Close Reference(error in=s7, reference=w34) -> (error out=w35)
          next s7 = w35
        }
        call "Define Preset Test Sequence.gviweb"() -> (Preset Test Sequence=w36)
        Array Size(array=w36) -> (size(s)=w24)
        Initialize Array(element="Step Status.gtype" {all zero or empty}, size=w24) -> w23
        call "Prep Step Staus for Display.gviweb"(Steps status out=w23) -> (Step Status=w37)
        Property Node(instance in=reference to "Step Status", "Value"=w37)
        call "Calculate Test Duration.gviweb"(Test Sequences=w36) -> (Total Duration (s)=w38)
        Property Node(instance in=reference to "Test Duration (s)", "Value"=w38)
        Property Node(instance in=reference to "Test Sequence", "Value"=w36) -> (error out=w39)
        call "Validate Test Sequence.gviweb"(Input=reference to "Test Sequence", UI Queue=w14, data=w36, error in=w39)
        w18 = s7
        w19 = default
        w20 = ""
        w21 = -1
        w22 = f64[][] []
        w25 = 0
      }
      frame "Handle Test Change" {
        Variant To Data(error in (no error)=w17, type="Test Step Data.gtype"[] [], variant=w16) -> (data=w40, error out=w41)
        Array Size(array=w40) -> (size(s)=w24)
        call "Calculate Test Duration.gviweb"(Test Sequences=w40) -> (Total Duration (s)=w42)
        $"Test Duration (s)" <- w42
        call "Validate Test Sequence.gviweb"(Input=reference to "Test Sequence", UI Queue=w14, data=w40, error in=w41) -> (Error out=w18)
        w19 = default
        w20 = s1
        w21 = s2
        w22 = s3
        w23 = s4
        w25 = s6
      }
      frame "Execute" {
        # start polling to process data from IO loop
        call "Report Step Complete.gviweb"(Manager Queue=w10, This Queue Name="UI", Step Name=w15, Input_3=w17) -> (Output_2=w18)
        w19 = default
        w20 = s1
        w21 = 0
        w22 = s3
        w23 = s4
        w24 = s5
        w25 = s6
      }
      frame "Update Status" {
        Variant To Data(error in (no error)=w17, type=string "", variant=w16) -> (data=w43, error out=w18)
        Format Into String(formatString="%s\n%s", s1, w43) -> w20
        $"Program Log" <- w20
        w19 = default
        w21 = s2
        w22 = s3
        w23 = s4
        w24 = s5
        w25 = s6
      }
      frame "Update Program Status" {
        Variant To Data(error in (no error)=w17, type=w15, variant=w16) -> (data=w44, error out=w18)
        $"Program Status" <- w44
        w19 = default
        w20 = s1
        w21 = s2
        w22 = s3
        w23 = s4
        w24 = s5
        w25 = s6
      }
      frame "Initialize Complete" {
        $Initialized <- TRUE
        w18 = w17
        w19 = default
        w20 = s1
        w21 = s2
        w22 = s3
        w23 = s4
        w24 = s5
        w25 = s6
      }
      frame "Initialize" {
        Property Node(instance in=reference to "Result", "Value"=FALSE)
        Property Node(instance in=reference to "Test Sequence", "Disabled"=TRUE)
        Property Node(instance in=reference to "Initialized", "Value"=FALSE)
        Property Node(instance in=reference to "Finalized", "Value"=FALSE)
        # Enure at least 1 step is present
        Max And Min(x=s5, y=1) -> (max(x,y)=w45: i32)
        Initialize Array(element="Step Status.gtype" {all zero or empty}, size=w45) -> w23
        call "Prep Step Staus for Display.gviweb"(Steps status out=w23) -> (Step Status=w46)
        Property Node(instance in=reference to "Step Status", "Value"=w46, error in=w17) -> (error out=w47)
        call "Report Step Complete.gviweb"(Manager Queue=w10, This Queue Name="UI", Step Name=w15, Input_3=w47) -> (Output_2=w18)
        w19 = default
        w20 = s1
        w21 = s2
        w22 = f64[][] []
        w24 = s5
        w25 = 0
      }
      frame "Execute Complete" {
        # Handle any data remaining in queue
        call "Handle Data Remaining in Queue.gviweb"(Input_3=reference to "Graph", Input_2=reference to "Step Status", Input_4=w5, Input_5=s6, Input=s3, Input_6=s4, Input_7=w17) -> (Output=w25, Output_3=w22, Output_4=w23, Output_2=w18)
        w19 = default
        w20 = s1
        w21 = s2
        w24 = s5
      }
      frame "Finalize" {
        s8 = "Pass"  # shift register
        for {
          w48 = each element of s4
          Property Node(instance in=w48) -> ("Result"=w49)
          case (s8) {
            frame "Pass", Default {
              w50 = w49
            }
            frame "Fail" {
              case (w49) {
                frame Default {
                  w50 = w49
                }
                frame "Pass" {
                  w50 = s8
                }
              }
            }
            frame "Canceled" {
              w51 = "Canceled"  # Step Result
              w50 = w51
            }
          }
          next s8 = w50
        }
        call "Get Result Color.gviweb"(Input=s8) -> (Output=w52)
        Format Into String(formatString="%s", s8) -> w53
        Build Array(w53) -> w54
        # stop polling
        Property Node(instance in=reference to "Result", "TrueColor"=w52, "Text"=w54)
        $Result <- TRUE
        Property Node(instance in=reference to "Test Sequence", "Disabled"=TRUE)
        call "Report Step Complete.gviweb"(Manager Queue=w10, This Queue Name="UI", Step Name=w15, Input_3=w17) -> (Output_2=w18)
        w19 = default
        w20 = s1
        w21 = -1
        w22 = s3
        w23 = s4
        w24 = s5
        w25 = s6
      }
      frame "Finalize Complete" {
        $Finalized <- TRUE
        Property Node(instance in=reference to "Test Sequence", "Disabled"=FALSE)
        w18 = w17
        w19 = default
        w20 = s1
        w21 = s2
        w22 = s3
        w23 = s4
        w24 = s5
        w25 = s6
      }
      frame "Cancel" {
        Array Index(array=s4) -> (out0[s6]=w55)
        Property Node(instance in=w55, "Result"="Canceled") -> (instance out=w56)
        Replace Array Subset(inArray=s4, index=s6, new=w56) -> w57
        call "Handle Data Remaining in Queue.gviweb"(Input_3=reference to "Graph", Input_2=reference to "Step Status", Input_4=w5, Input_5=s6, Input=s3, Input_6=w57, Input_7=w17) -> (Output=w25, Output_3=w22, Output_4=w23, Output_2=w58)
        call "Report Step Complete.gviweb"(Manager Queue=w10, This Queue Name="UI", Step Name=w15, Input_3=w58) -> (Output_2=w18)
        w19 = default
        w20 = s1
        w21 = s2
        w24 = s5
      }
      frame "Cancel Complete" {
        w18 = w17
        w19 = default
        w20 = s1
        w21 = s2
        w22 = s3
        w23 = s4
        w24 = s5
        w25 = s6
      }
      frame "Exit" {
        Release Queue(queue=w14) -> (error out=w59)
        Release Queue(queue=w5) -> (error out=w60)
        Merge Errors(w17, w59, w60) -> (error out=w18)
        w19 = TRUE
        w20 = s1
        w21 = s2
        w22 = s3
        w23 = s4
        w24 = s5
        w25 = s6
      }
      frame Default {
        case (w13) {
          frame True {
            Wait(time to wait=500)
            call "Receive IO Data.gviweb"(Test data in=s3, Steps status in=s4, Step Index in=s6, error in=w17, IO Data Queue=w5) -> (Test data out=w22, Steps status out=w23, Step Index out=w25, error out=w18, Test Data for Graph=w61)
            $Graph <- w61
            call "Prep Step Staus for Display.gviweb"(Steps status out=w23) -> (Step Status=w62)
            $"Step Status" <- w62
          }
          frame False {
            call "Generate Undefined Message Error.gviweb"(Queue Name="UI", Message=w15, Error in=w17) -> (Error out=w18)
            w22 = s3
            w23 = s4
            w25 = s6
          }
        }
        w19 = default
        w20 = s1
        w21 = s2
        w24 = s5
      }
    }
    call "Handle Error.gviweb"(Input=w10, Input_2="UI", Output_2=w18) -> (Output_3=w63)
    next s1 = w20
    next s2 = w21
    next s3 = w22
    next s4 = w23
    next s5 = w24
    next s6 = w25
    stop if w19
  }
  Array Index(array=w8) -> (out0["Manager"]=w64, out1["IO"]=w65)
  s9 = uninitialised  # shift register
  s10 = uninitialised  # shift register
  while {
    call "Dequeue Message.gvi"(message queue in=w65, timeout in milliseconds=0, error in=w9) -> (timed out?=w66, message queue out=w67, message=w68, message data=w69, error out=w70)
    # UI Update Loop
    case (w68) ignore case {  # Message Cases
      frame "SW Init" {
        w71 = w70
        w72 = default
        w73 = s9
        w74 = "IO Data.gtype" {all zero or empty}
      }
      frame "Initialize" {
        disable {
          frame Disabled {
            # #Integrate_Hardware
            # Hardware uninitialization goes here
            w75 = w70
          }
          frame Enabled {
            call "globals.gviweb"() -> (Globals=w76)
            Property Node(instance in=w76) -> ("Hardware Initialize Duration (s)"=w77)
            # #debug
            Multiply(w77, 1000) -> w78
            Wait(time to wait=w78)
            w75 = w70
          }
        }
        call "Report Step Complete.gviweb"(Manager Queue=w64, This Queue Name="IO", Step Name=w68, Input_3=w75) -> (Output_2=w71)
        w72 = default
        w73 = s9
        w74 = s10
      }
      frame "Finalize" {
        disable {
          frame Disabled {
            # #Integrate_Hardware
            # Hardware uninitialization goes here
            w79 = w70
          }
          frame Enabled {
            call "globals.gviweb"() -> (Globals=w80)
            Property Node(instance in=w80) -> ("Hardware Finalize Duration (s)"=w81)
            # #debug
            Multiply(w81, 1000) -> w82
            Wait(time to wait=w82)
            w79 = w70
          }
        }
        call "Report Step Complete.gviweb"(Manager Queue=w64, This Queue Name="IO", Step Name=w68, Input_3=w79) -> (Output_2=w71)
        w72 = default
        w73 = s9
        w74 = s10
      }
      frame "Execute" {
        # #todo move some of this functionality to initialization and check if test sequence is empty
        # report empty back to manager
        call "Handle Next Waveform.gviweb"(Test Sequence in=$"Test Sequence", IO Data In=s10) -> (Test Sequence out=w73, IO Data out=w74)
        w71 = w70
        w72 = default
      }
      frame "Cancel" {
        sequence {
          frame 0 {
            # Stop IO
            Property Node(instance in=s10, "Wave Active"=FALSE) -> (instance out=w74)
          }
        }
        call "Report Step Complete.gviweb"(Manager Queue=w64, This Queue Name="IO", Step Name=w68, Input_3=w70) -> (Output_2=w71)
        w72 = default
        w73 = s9
      }
      frame "Exit" {
        Release Queue(queue=w67) -> (error out=w83)
        Merge Errors(w70, w83) -> (error out=w71)
        w72 = TRUE
        w73 = s9
        w74 = s10
      }
      frame Default {
        case (w66) {
          frame True {
            Property Node(instance in=s10) -> ("Wave Active"=w84, instance out=w85)
            # No message -> handle output
            case (w84) {
              frame False, Default {
                w74 = w85
                w71 = w70
                w73 = s9
              }
              frame True {
                Property Node(instance in=w85) -> ("New Wave"=w86, instance out=w87)
                case (w86) {
                  frame False, Default {
                    w88 = w87
                  }
                  frame True {
                    Get Current Time() -> (current time=w89)
                    # only save init timestamp at wave start
                    Property Node(instance in=w87, "Start Time"=w89, "New Wave"=FALSE) -> (instance out=w88)
                  }
                }
                call "Generate Waveform.gviweb"(IO Data=w88) -> (Time Elapsed=w90, IO data out=w91, Wave Value=w92, Fraction Complete=w93)
                call "Handle Hardware IO.gviweb"(IO data in=w91, Hardware output=w92, Time Elapsed=w90) -> (IO data out=w94, Hardware input=w95)
                call "Check Test Sequence Complete.gviweb"(This Queue Name="IO", Test Sequence in=s9, IO data in=w94, Fraction Complete=w93, Manager Queue=w64) -> (Test Sequence out=w73, IO data out=w74, Fraction Complete (includes messages)=w96)
                Build Array(w96, w92, w95) -> w97
                Enqueue Element(element=w97, error in=w70, queue=w5) -> (error out=w71)
              }
            }
          }
          frame False {
            # Received message
            call "Generate Undefined Message Error.gviweb"(Queue Name="IO", Message=w68, Error in=w70) -> (Error out=w71)
            w74 = s10
            w73 = s9
          }
        }
        w72 = default
      }
    }
    call "Handle Error.gviweb"(Input=w64, Input_2="IO", Output_2=w71) -> (Output_3=w98)
    Wait(time to wait=50)
    next s9 = w73
    next s10 = w74
    stop if w72
  }
  Array Index(array=w8) -> (out0["Manager"]=w99)
  call "Define Program Instructions.gviweb"() -> (Instructions=w100, Instruction names=w101)
  s11 = uninitialised  # shift register
  while {
    # w8: Message Queues
    call "Dequeue Message.gvi"(message queue in=w99, error in=w9) -> (message queue out=w102, message=w103, message data=w104, error out=w105)
    # "Manager": Manager Queue Name
    # w3: Stop Event
    # s11: Manager Data
    # w100: Instructions
    # w101: Instruction Names
    case (w103) ignore case {  # Message Cases
      frame "SW Init" {
        w106 = w105
        w107 = default
        w108 = "Manager Data.gtype" {all zero or empty}
      }
      frame "Test Sequence Change" {
        Array Index(array=w8) -> (out0["UI"]=w109)
        call "Enqueue Message (Single).gvi"(message queue in=w109, message="Handle Test Change", message data=w104, error in=w105) -> (error out=w106)
        w107 = default
        w108 = s11
      }
      frame "Error" {
        Variant To Data(error in (no error)=w105, type="Error Data.gtype" {all zero or empty}, variant=w104) -> (data=w110, error out=w111)
        Property Node(instance in=w110) -> ("Error Origin"=w112, "Error In"=w113)
        Property Node(instance in=w113) -> ("code"=w114, "source"=w115)
        w116 = "================\nError\n\nAt: %s\n\nCode: %d\n%s\n================"
        Format Into String(formatString=w116, errIn=w111, w112, w114, w115) -> (outString=w117, errOut=w118)
        call "Append Log Text.gviweb"(Message Queues in=w8, Update Tex=w117, Error in=w118) -> (Error out_2=w106)
        w107 = default
        w108 = s11
      }
      frame "Exit Pressed" {
        # #development
        s12 = w105  # shift register
        for {
          w119 = each element of w8
          call "Enqueue Message (Single).gvi"(message queue in=w119, message="Exit", error in=s12) -> (error out=w120)
          next s12 = w120
        }
        w106 = s12
        w107 = default
        w108 = s11
      }
      frame "Exit" {
        Generate User Event(event data=TRUE, user event=w3) -> (error out=w121)
        Release Queue(queue=w102) -> (error out=w122)
        Merge Errors(w122, w121) -> (error out=w106)
        w107 = TRUE
        w108 = s11
      }
      frame Default {
        call "Generate Undefined Message Error.gviweb"(Queue Name="Manager", Message=w103, Error in=w105) -> (Error out=w106)
        w107 = default
        w108 = s11
      }
      frame "Instruction" {
        # w123: Instruction Name
        Variant To Data(error in (no error)=w105, type=w103, variant=w104) -> (data=w123, error out=w124)
        Search 1D Array(1D array=w101, element=w123) -> (index of element=w125)
        case (w125) {
          frame Default {
            Array Index(array=w100) -> (out0[w125]=w126)
            Property Node(instance in=w126) -> ("Init Info:Valid Starts"=w127, instance out=w128)
            Property Node(instance in=s11) -> ("Current State"=w129, instance out=w130)
            Search 1D Array(1D array=w127, element=w129) -> (index of element=w131)
            # Message in sequence start list -> ensure in valid start state
            case (w131) {
              frame Default {
                # In valid state for recieved message -> react
                Property Node(instance in=w128) -> ("Sequences"=w132)
                Format Into String(formatString="******************\nStart: %s\n******************", errIn=w124, w123) -> (outString=w133, errOut=w134)
                call "Append Log Text.gviweb"(Message Queues in=w8, Update Tex=w133, Error in=w134) -> (Message Queues out=w135, Error out_2=w136)
                call "Handle Next Sequence.gviweb"(Manager data in=w130, Sequences=w132, error in=w136, Message Queues=w135) -> (manager data out=w137, Sequence Steps=w138, End Instruction=w139, error out=w140, Message Queues out=w141)
                case (w139) {
                  frame True {
                    # #verify - new instruction, but sequences empty
                    w142 = "-------------------------------------\nInstruction Sequences Empty\n-------------------------------------"
                    call "Append Log Text.gviweb"(Message Queues in=w141, Update Tex=w142, Error in=w140) -> (Error out_2=w106)
                    w108 = w137
                  }
                  frame False {
                    Property Node(instance in=w137, "Current Instruction"=w123) -> (instance out=w143)
                    # Start first step in first sequence
                    call "Handle Next Step.gviweb"(Manager Data in=w143, Sequence Steps=w138, Error in=w140, Nessage Queues in=w141) -> (Manager Data out=w108, Error out=w106)
                  }
                }
              }
              frame -1 {
                w144 = """-------------------------------------
Received inavalid message for current status

Invalid Message: %s

State: %s
Currently waiting on: %s
-------------------------------------"""
                Property Node(instance in=w130) -> ("Current State"=w145, "Current Step:Message Queue"=w146)
                Format Into String(formatString=w144, errIn=w124, w123, w145, w146) -> (outString=w147, errOut=w148)
                call "Append Log Text.gviweb"(Message Queues in=w8, Update Tex=w147, Error in=w148) -> (Error out_2=w106)
                w108 = w130
              }
            }
          }
          frame -1 {
            # Instruction name missing from list -> undefined
            Format Into String(formatString="Instruction \"%s\" undefined.", w123) -> w149
            call "Build Error Cluster.gvi"(code=1, description=w149, error in=w124) -> (error out=w106)
            w108 = s11
          }
        }
        w107 = default
      }
      frame "Step Complete" {
        Property Node(instance in=s11) -> ("Current Step"=w150)
        Variant To Data(error in (no error)=w105, type=w150, variant=w104) -> (data=w151, error out=w152)
        Is Equal[ComparisonMode=CompareAggregates](x=w150, y=w151) -> w153
        case (w153) {
          frame False, Default {
            w154 = "Unexpected \"Step Complete\" message \n\nFrom: %s with action %s\nExpected: %s with action %s"
            Property Node(instance in=w151) -> ("Message Queue"=w155, "Action"=w156)
            Property Node(instance in=w150) -> ("Message Queue"=w157, "Action"=w158)
            Format Into String(formatString=w154, w155, w156, w157, w158) -> w159
            call "Append Log Text.gviweb"(Message Queues in=w8, Update Tex=w159, Error in=w152) -> (Error out_2=w106)
            w108 = s11
          }
          frame True {
            # Expected complete message received
            Property Node(instance in=s11) -> ("Remaining Steps"=w160, instance out=w161)
            Array Size(array=w160) -> (size(s)=w162)
            Property Node(instance in=w150) -> ("Message Queue"=w163, "Action"=w164)
            Format Into String(formatString="Completed %s %s", errIn=w152, w163, w164) -> (outString=w165, errOut=w166)
            call "Append Log Text.gviweb"(Message Queues in=w8, Update Tex=w165, Error in=w166) -> (Message Queues out=w167, Error out_2=w168)
            case (w162) {
              frame Default {
                # Steps remaining -> handle next step
                call "Handle Next Step.gviweb"(Manager Data in=w161, Sequence Steps=w160, Error in=w168, Nessage Queues in=w167) -> (Manager Data out=w108, Error out=w106)
              }
              frame 0 {
                Property Node(instance in=w161) -> ("Remaining Sequences"=w169, "Current State"=w170, instance out=w171)
                call "Send Sequence Complete UI Updates.gviweb"(Message queues in=w167, Current State=w170, Error In=w168) -> (Message queues out=w172, Error out=w173)
                call "Handle Next Sequence.gviweb"(Manager data in=w171, Sequences=w169, error in=w173, Message Queues=w172) -> (manager data out=w174, Sequence Steps=w175, End Instruction=w176, error out=w177, Message Queues out=w178)
                Property Node(instance in=w174) -> ("Current State"=w179, instance out=w180)
                # Sequence complete -> handle next sequence if it exists
                Format Into String(formatString="%s", errIn=w177, w179) -> (outString=w181, errOut=w182)
                call "Update Program Status.gviweb"(Message Queues in=w178, Status=w181, Error in=w182) -> (Message Queues out=w183, Error out=w184)
                case (w176) {
                  frame False, Default {
                    # Handle next step of next sequence
                    call "Handle Next Step.gviweb"(Manager Data in=w180, Sequence Steps=w175, Error in=w184, Nessage Queues in=w183) -> (Manager Data out=w108, Error out=w106)
                  }
                  frame True {
                    Property Node(instance in=w180) -> ("Current Instruction"=w185, instance out=w186)
                    # No more sequences -> Instruction complete
                    # prevents confusion of manager possibly waiting on another loop
                    Property Node(instance in=w186, "Current Step:Message Queue"="Manager") -> (instance out=w108)
                    Format Into String(formatString="******************\nComplete: %s\n******************", errIn=w184, w185) -> (outString=w187, errOut=w188)
                    call "Append Log Text.gviweb"(Message Queues in=w183, Update Tex=w187, Error in=w188) -> (Error out_2=w106)
                  }
                }
              }
            }
          }
        }
        w107 = default
      }
    }
    call "Handle Error.gviweb"(Input=w102, Input_2="Manager", Output_2=w106) -> (Output_3=w189)
    next s11 = w108
    stop if w107
  }
  Register For Events("Stop Event"=w3) -> (event registration refnum out=w190)
  # #todo
  # hide exit button conditionally with flag - if possible
  # make UI more presentable
  #
  # change status text so instruction, sequence and steps are clearly identifiable
  # 	sequence not to be confused with test sequence (maybe change one to routine?)
  # create/ configure simulation cases/ flags
  # clean up
  # 	UI loop
  # 	IO loop
  # 	save all text log messages in same place
  Array Index(array=w8) -> (out0["Manager"]=w191)
  # This framework behind this sequencer operates by handling instructions (command lists) in the instruction case of the manager loop. The instruction will only begin if the manager is in a valid state to accept it. Instructions are initiated by sending an "Instruction" message via the manager's queue. The sequences in that instruction and their nested steps are then executed sequentially with the manager expecting a response to indicate each step's completion via the Report Step Complete VI. The manager will then continue on the to next step and next sequence as they're store in the sequences array via the logic in the "Step Complete" case. In each sequence element, a manager state name is defined. There's also a nested array containing the individual steps to be executed, each containing a message queue/ loop name and a message defining the action to be completed. The names of the step messages do not have to match the name of the manager state for that sequence.
  #
  # Note:
  # - The names of the step messages do not have to match the name of the manager state for that sequence.
  # - Instructions cannot be queued. There can only be one active at a time.
  # - Instruction names, start states and corresponding sequences are defined and stored in the Define Program Instructions VI, being made available to the manager at program start.
  # Run Test Sequence example
  #
  # State: Idle
  #
  # Start Pressed
  #
  # Initialize
  # 	>> To UI ---Initialize
  # 	Waiting on UI
  # 	>> To IO ---Initialize
  # 	Waiting on IO
  # Execute
  # 	>> To UI ---Execute
  # 	Waiting on UI
  # 	>> To IO ---Execute
  # 	Waiting on IO
  # Finalize
  # 	>> To IO ---Finalize
  # 	Waiting on IO
  # 	>> To UI ---Finalize
  # 	Waiting on UI
  # Idle
  s13 = w190  # shift register
  while {
    event (dynamic events = s13) {
      on "Test Start" Value changed {
        call "Enqueue Message (Single).gvi"(message queue in=w191, message="Instruction", message data="Run Test Sequence") -> (message queue out=w194, error out=w193)
        w192 = default
      }
      on "Cancel" Value changed {
        call "Enqueue Message (Single).gvi"(message queue in=w191, message="Instruction", message data="Cancel") -> (message queue out=w194, error out=w193)
        w192 = default
      }
      on "Exit (development only)" Value changed {
        call "Enqueue Message (Single).gvi"(priority message=TRUE, message queue in=w191, message="Exit Pressed") -> (message queue out=w194, error out=w193)
        w192 = default
      }
      on dynamic event 0 {
        # The Message Handling Loop processed an "Exit" message, which fired this event to stop the Event Handling Loop.
        w192 = TRUE
        w193 = default
        w194 = w191
      }
      on "Test Sequence" Value changed {
        Event Data() -> ("New Value"=w195)
        To Variant(anything=w195) -> w196
        call "Enqueue Message (Single).gvi"(message queue in=w191, message="Test Sequence Change", message data=w196) -> (message queue out=w194, error out=w193)
        w192 = default
      }
    }
    call "Error Handler - Event Handling Loop.gvi"(message queue in=w194, error in=w193) -> (dup error in=w197)
    stop if w192
  }
  Unregister For Events(error in=w197, event registration refnum=s13) -> (error out=w198)
  Merge Errors(w198, w189, w63, w98) -> (error out=w199)
  Destroy User Event(error in=w199, user event=w3)
